# Grasshopper definition AnalyseBrep_1.gh (Grasshopper 1.0.7)
# plug-ins: MindeskText, ViewDeformations, SurfaceSlider, StressDirectionSlider, PartitionSlider, PointsToBrep, MDSKGrasshopper, SetUniBC, ViewStresses, PreDef, LoadSlider, SetUniLoad, MeshTBrep, FEMeshTBrep, DeformationSlider, ClosestPoint

pt = Point([<point referenced from the Rhino model> x8])
# PREDEF
sphere = Brep()
load_value = Curve(<curve referenced from the Rhino model>)
load_surf = Curve(<curve referenced from the Rhino model>)
# LOAD AND BC
bc_surf = Curve(<curve referenced from the Rhino model>)
brep = Brep(<brep referenced from the Rhino model>)
# MESHING
_3_mesh_curves = Curve([<curve referenced from the Rhino model> x3])
# BREP
p2b = PointsToBrep(Points=pt)
surfslider = SurfaceSlider(SliderVR=load_surf, Brep=p2b)  # -> Surface, Text, Size, Plane, Colors, Geometry
surfslider_2 = SurfaceSlider(SliderVR=bc_surf, Brep=p2b)  # -> Surface, Text, Size, Plane, Colors, Geometry
divslider = DivisionSlider(SliderVR=_3_mesh_curves, Brep=p2b)  # -> MeshDivisionU, MeshDivisionV, MeshDivisionW, Text, Size, Plane, Colors, Geometry
mdsk_text = VRTEXT(Text=surfslider.Text, Size=surfslider.Size, Plane=surfslider.Plane, Color=surfslider.Colors, Start=False)
loadslider = LoadSlider(SliderVR=load_value, Brep=p2b)  # -> Load, Text, Size, Plane, Colors, Geometry
# MODEL TOGGLE
model_toggle = BooleanToggle(False)
mdsk_text_2 = VRTEXT(Text=divslider.Text, Size=divslider.Size, Plane=divslider.Plane, Color=divslider.Colors, Start=model_toggle)
mdsk_text_3 = VRTEXT(Text=surfslider_2.Text, Size=surfslider_2.Size, Plane=surfslider_2.Plane, Color=surfslider_2.Colors, Start=model_toggle)
mdsk_geometry = MDSK(Geometry=divslider.Geometry, Color=divslider.Colors, Start=model_toggle)
mdsk_geometry_2 = MDSK(Geometry=surfslider_2.Geometry, Color=surfslider_2.Colors, Start=model_toggle)
mdsk_geometry_3 = MDSK(Geometry=surfslider.Geometry, Color=surfslider.Colors, Start=model_toggle)
mdsk_text_4 = VRTEXT(Text=loadslider.Text, Size=loadslider.Size, Plane=loadslider.Plane, Color=loadslider.Colors, Start=model_toggle)
unibc = UniformBCComponentForFEA(
    Surface=surfslider_2.Surface,
    UCount=divslider.MeshDivisionU,
    VCount=divslider.MeshDivisionV,
    WCount=divslider.MeshDivisionW,
    Brep=p2b)  # -> BCPoints, BCCones, ColoringForBCCones
uniloads = UniformLoadComponentForFEA(
    Surface=surfslider.Surface,
    LoadVector=loadslider.Load,
    UCount=divslider.MeshDivisionU,
    VCount=divslider.MeshDivisionV,
    WCount=divslider.MeshDivisionW,
    Brep=p2b)  # -> PointLoads, LoadArrows, ArrowColoring
mdsk_geometry_4 = MDSK(Geometry=loadslider.Geometry, Color=loadslider.Colors, Start=model_toggle)
mdsk_geometry_5 = MDSK(Geometry=uniloads.LoadArrows, Color=uniloads.ArrowColoring, Start=model_toggle)
mdsk_geometry_6 = MDSK(Geometry=unibc.BCCones, Color=unibc.ColoringForBCCones, Start=model_toggle)
vec = VectorXYZ(XComponent=0, YComponent=0, ZComponent=0)  # -> Vector, Length
meshtbrep = MeshTBrep(TBrep=p2b, UCount=divslider.MeshDivisionU, VCount=divslider.MeshDivisionV, WCount=divslider.MeshDivisionW)  # -> Connectivity, Nodes
closest_point = FindTheClosestPointToSphere(Sphere=sphere, Connectivity=meshtbrep.Connectivity, Nodes=meshtbrep.Nodes)  # -> Point, Text, Plane, Colors
predef = PreDef(Points=closest_point.Point, PrescribedDeformations=vec.Vector)
# ANALYSE TOGGLE
preview_toggle = BooleanToggle(False)
# ANALYSE
femeshtbrep = FiniteElementOfMeshedTBrep(
    Connectivity=meshtbrep.Connectivity,
    Nodes=meshtbrep.Nodes,
    BoundaryConditions=unibc.BCPoints,
    PointLoads=uniloads.PointLoads,
    PreDeformations=predef,
    Brep=p2b)  # -> Displacement, Strain, Stress, Nodes, Text, Size, Plane, ColorT
mdsk_text_5 = VRTEXT(Text=femeshtbrep.Text, Size=femeshtbrep.Size, Plane=femeshtbrep.Plane, Color=femeshtbrep.ColorT, Start=preview_toggle)
scale_def_curve = Curve(<curve referenced from the Rhino model>)
stress_direction = Curve(<curve referenced from the Rhino model>)
defslider = DeformationSlider(SliderVR=scale_def_curve)  # -> Scale, Text, Size, Plane, Colors, Geometry
stressslider = StressDirectionSlider(SliderVR=stress_direction)  # -> StressDirection, Text, Size, Plane, Color, Geometry
# DEFORMATION PREVIEW
viewdef = ViewDeformations(
    Connectivity=meshtbrep.Connectivity,
    PointsForBreps=meshtbrep.Nodes,
    Displacement=femeshtbrep.Displacement,
    Scaling=defslider.Scale,
    Brep=p2b)  # -> BrepSolid, ColorSolid, BrepOuterEdges, ColorEdges, Text, Size, Plane, ColorT
# STRESS PREVIEW
viewstress = ViewStresses(
    Connectivity=meshtbrep.Connectivity,
    PointsForBreps=meshtbrep.Nodes,
    Stresses=femeshtbrep.Stress,
    StressDirection=stressslider.StressDirection,
    Displacement=femeshtbrep.Displacement,
    Scaling=defslider.Scale,
    Brep=p2b)  # -> Solid, Color_solid, Legend, Color_legend, Text, Size, Plane, Color_T
mdsk_text_6 = VRTEXT(Text=viewdef.Text, Size=viewdef.Size, Plane=viewdef.Plane, Color=viewdef.ColorT, Start=preview_toggle)
mdsk_text_7 = VRTEXT(Text=viewstress.Text, Size=viewstress.Size, Plane=viewstress.Plane, Color=viewstress.Color_T, Start=preview_toggle)
mdsk_geometry_7 = MDSK(Geometry=viewdef.BrepSolid, Color=viewdef.ColorSolid, Start=preview_toggle)
mdsk_geometry_8 = MDSK(Geometry=viewdef.BrepOuterEdges, Color=viewdef.ColorEdges, Start=preview_toggle)
mdsk_geometry_9 = MDSK(Geometry=viewstress.Solid, Color=viewstress.Color_solid, Start=preview_toggle)
mdsk_geometry_10 = MDSK(Geometry=viewstress.Legend, Color=viewstress.Color_legend, Start=preview_toggle)
