# Grasshopper definition ArchComparing.gh (Grasshopper 1.0.7)
# plug-ins: SolidsVR

pt = ConstructPoint(XCoordinate=Slider(-50, range=-50..50), YCoordinate=Slider(-50, range=-50..50), ZCoordinate=0)
pt_2 = ConstructPoint(XCoordinate=Slider(50, range=-50..50), YCoordinate=Slider(-50, range=-50..50), ZCoordinate=0)
pt_3 = ConstructPoint(XCoordinate=Slider(50, range=-50..50), YCoordinate=Slider(50, range=-50..50), ZCoordinate=0)
pt_4 = ConstructPoint(XCoordinate=Slider(-50, range=-50..50), YCoordinate=Slider(50, range=-50..50), ZCoordinate=0)
pt_5 = ConstructPoint(XCoordinate=Slider(1050, range=950..1050), YCoordinate=Slider(-50, range=-50..50), ZCoordinate=0)
pt_6 = ConstructPoint(XCoordinate=0, YCoordinate=0, ZCoordinate=0)
pt_7 = ConstructPoint(XCoordinate=Slider(950, range=950..1050), YCoordinate=Slider(50, range=-50..50), ZCoordinate=0)
pt_8 = ConstructPoint(XCoordinate=Slider(1050, range=950..1050), YCoordinate=Slider(50, range=-50..50), ZCoordinate=0)
pt_9 = ConstructPoint(XCoordinate=Slider(950, range=950..1050), YCoordinate=Slider(-50, range=-50..50), ZCoordinate=0)
pt_10 = ConstructPoint(XCoordinate=Slider(50, range=-50..50), YCoordinate=Slider(50, range=-50..50), ZCoordinate=0)
pt_11 = ConstructPoint(XCoordinate=Slider(1000, range=0..1000), YCoordinate=0, ZCoordinate=Slider(0, range=0..100))
pt_12 = ConstructPoint(XCoordinate=Slider(500, range=0..500), YCoordinate=0, ZCoordinate=Slider(500, range=0..500))
pt_13 = ConstructPoint(XCoordinate=Slider(-50, range=-50..50), YCoordinate=Slider(-50, range=-50..50), ZCoordinate=0)
pt_14 = Point([pt, pt_2, pt_3, pt_4, pt_5, pt_9, pt_7, pt_8])
arc = Arc3Pt(PointA=pt_6, PointB=pt_12, PointC=pt_11)  # -> Arc, Plane, Radius
rec_2pt = Rectangle2Pt(Plane=PlaneXY(0, 0, 0), PointA=pt_13, PointB=pt_10, Radius=0)  # -> Rectangle, Length
swp1 = Sweep1(Rail=arc.Arc, Sections=rec_2pt.Rectangle, Miter=1)
cap = CapHoles(Brep=swp1)
meshcbrep = MeshCBrep(Brep=cap, Point=pt_14, UCount=Slider(3, range=0..10), VCount=Slider(3, range=0..10), WCount=Slider(20, range=0..30))
debrep = DeconstructBrep()  # -> Faces, Edges, Vertices
deconstruct_meshcbrep = DeconstructMesh(Mesh=meshcbrep)  # -> ElementVertices, Connectivity, Edges, Surfaces, Points, Nodes, Elements
Z = UnitZ(Factor="-10")
Z_2 = UnitZ(Factor=Slider(0, range=0..100))
unibc = UniformBCComponentForFEA(SurfaceNumber=Slider(4, range=0..5), Mesh=meshcbrep)  # -> BCPoints, BCCones, ColoringForBCCones
unibc_2 = UniformBCComponentForFEA(SurfaceNumber=Slider(5, range=0..5), Mesh=meshcbrep)  # -> BCPoints, BCCones, ColoringForBCCones
uniloads = UniformLoadComponentForFEA(SurfaceNumber=Slider(3, range=0..5), LoadVector=Z, Mesh=meshcbrep)  # -> PointLoads, LoadArrows, ArrowColoring
predef = PreDef(Points="0,0,0", PrescribedDeformations=Z_2)
material = CreateMaterial(EModulus="210000", PRatio="0.3")
femeshtbrep = FiniteElementOfMeshedTBrep(
    Mesh=meshcbrep,
    BoundaryConditions=[unibc_2.BCPoints, unibc.BCPoints],
    PointLoads=uniloads.PointLoads,
    PreDeformations=predef,
    Brep=cap,
    Material=material)  # -> Disp, Strain, Stress, N, Text, Size, Plane, Color_T, Nodes
item = ListItem(List=femeshtbrep.N, Index=Slider(161, range=0..1000), Wrap=True)
flatten = FlattenTree(Tree=femeshtbrep.Disp, Path="{0}")
panel = Panel(femeshtbrep.Stress)
panel_2 = Panel(item)
sort = SortList(Keys=flatten)  # -> Keys, ValuesA
panel_3 = Panel(sort.Keys)
