# Grasshopper definition CurveBrep.gh (Grasshopper 1.0.7)
# plug-ins: SolidsVR

number_slider = Slider(10, range=0..10)
number_slider_2 = Slider(10, range=0..10)
number_slider_3 = Slider(10, range=0..10)
number_slider_4 = Slider(5, range=0..10)
number_slider_5 = Slider(10, range=0..10)
pt = ConstructPoint(XCoordinate=number_slider_4, YCoordinate=0, ZCoordinate=number_slider_4)
pt_2 = ConstructPoint(XCoordinate=Slider(33, range=0..110), YCoordinate=Slider(33, range=0..110), ZCoordinate=Slider(5, range=0..10))
pt_3 = ConstructPoint(XCoordinate=Slider(64, range=0..110), YCoordinate=Slider(33, range=0..110), ZCoordinate=Slider(5, range=0..10))
pt_4 = ConstructPoint(XCoordinate=Slider(105, range=0..110), YCoordinate=0, ZCoordinate=Slider(5, range=0..10))
pt_5 = ConstructPoint(XCoordinate=Slider(100, range=0..110), YCoordinate=0, ZCoordinate=Slider(10, range=0..10))
pt_6 = ConstructPoint(XCoordinate=Slider(110, range=0..110), YCoordinate=0, ZCoordinate=Slider(10, range=0..10))
pt_7 = ConstructPoint(XCoordinate=Slider(100, range=0..110), YCoordinate=0, ZCoordinate=0)
pt_8 = ConstructPoint(XCoordinate=0, YCoordinate=0, ZCoordinate=Slider(10, range=0..10))
pt_9 = ConstructPoint(XCoordinate=0, YCoordinate=0, ZCoordinate=0)
pt_10 = ConstructPoint(XCoordinate=number_slider_5, YCoordinate=0, ZCoordinate=number_slider_5)
pt_11 = ConstructPoint(XCoordinate=Slider(10, range=0..10), YCoordinate=0, ZCoordinate=0)
pt_12 = ConstructPoint(XCoordinate=Slider(110, range=0..110), YCoordinate=0, ZCoordinate=0)
pline = PolyLine(Vertices=[pt_6, pt_5, pt_7, pt_12], Closed=Toggle(True))
pline_2 = PolyLine(Vertices=[pt_8, pt_10, pt_11, pt_9], Closed=Toggle(True))
nurbs = NurbsCurve(Vertices=[pt, pt_2, pt_3, pt_4], Degree=3, Periodic=False)  # -> Curve, Length, Domain
swp2 = Sweep2(SameHeight=False)
swp1 = Sweep1(Rail=nurbs.Curve, Sections=[pline_2, pline], Miter=1)
cap = CapHoles(Brep=swp1)
brep = Brep(cap)
meshcbrep = MeshCBrep(Brep=brep, UCount=1, VCount=1, WCount=1)
debrep = DeconstructBrep(Brep=brep)  # -> Faces, Edges, Vertices
item = ListItem(List=debrep.Vertices, Index=Slider(4, range=0..7), Wrap=True)
item_2 = ListItem(List=debrep.Faces, Index=Slider(5, range=0..7), Wrap=True)
item_3 = ListItem(List=debrep.Edges, Index=Slider(8, range=0..12), Wrap=True)
divide = DivideCurve(Curve=debrep.Edges, Count=10, Kinks=False)  # -> Points, Tangents, Parameters
